# Dynamo graph facade_system.dyn (Dynamo 4.1.0.4676)
# author: AEC Computational Designer
# Detailed Parametric Curtain Wall Façade System. Generated dynamically to match Rhino Grasshopper workflow.

# group: A: GRID & BAYS
num_bays = IntegerSlider(5, range=1..10 step 1)  # graph input
num_floors = IntegerSlider(4, range=1..5 step 1)  # graph input
bay_width = DoubleSlider(2.1, range=0.8..3 step 0.1)  # graph input
floor_height = DoubleSlider(3.5, range=2.5..5 step 0.1)  # graph input

# group: B: STRUCTURAL PROFILES
mullion_w = DoubleSlider(0.06, range=0.03..0.1 step 0.001)  # graph input
mullion_d = DoubleSlider(0.15, range=0.08..0.25 step 0.001)  # graph input
mullion_t = DoubleSlider(0.003, range=0.002..0.008 step 0.001)  # graph input
transom_w = DoubleSlider(0.06, range=0.03..0.1 step 0.001)  # graph input
transom_d = DoubleSlider(0.12, range=0.06..0.2 step 0.001)  # graph input
transom_t = DoubleSlider(0.003, range=0.002..0.008 step 0.001)  # graph input

# group: C: INSULATED GLAZING (IGU)
glass_outer_t = DoubleSlider(0.006, range=0.004..0.015 step 0.001)  # graph input
glass_inner_t = DoubleSlider(0.006, range=0.004..0.015 step 0.001)  # graph input
glass_gap_t = DoubleSlider(0.016, range=0.008..0.024 step 0.001)  # graph input
glass_reveal = DoubleSlider(0.015, range=0.005..0.025 step 0.001)  # graph input
glass_setback = DoubleSlider(0.04, range=0.02..0.08 step 0.001)  # graph input

# group: D: GASKETS & PRESSURE PLATES
gasket_t = DoubleSlider(0.004, range=0.002..0.01 step 0.001)  # graph input
gasket_w = DoubleSlider(0.012, range=0.005..0.02 step 0.001)  # graph input
isolator_w = DoubleSlider(0.012, range=0.006..0.024 step 0.001)  # graph input
pressure_plate_t = DoubleSlider(0.006, range=0.004..0.015 step 0.001)  # graph input
cover_cap_d = DoubleSlider(0.02, range=0.01..0.05 step 0.001)  # graph input

# group: E: SLAB & ANCHOR BRACKETS
slab_t = DoubleSlider(0.3, range=0.15..0.5 step 0.1)  # graph input
slab_depth = DoubleSlider(1.5, range=0.5..2.5 step 0.1)  # graph input
slab_inset = DoubleSlider(0.01, range=0.005..0.05 step 0.1)  # graph input
bracket_w = DoubleSlider(0.08, range=0.04..0.15 step 0.001)  # graph input
bracket_l1 = DoubleSlider(0.15, range=0.08..0.3 step 0.001)  # graph input
bracket_l2 = DoubleSlider(0.12, range=0.06..0.25 step 0.001)  # graph input
bracket_t = DoubleSlider(0.008, range=0.004..0.016 step 0.001)  # graph input

# group: KINETIC CURTAIN WALL ENGINE
kinetic_curtain_wall_engine = Python(in_0=num_bays, in_1=num_floors, in_2=bay_width, in_3=floor_height, in_4=mullion_w, in_5=mullion_d, in_6=mullion_t, in_7=transom_w, in_8=transom_d, in_9=transom_t, in_10=glass_outer_t, in_11=glass_inner_t, in_12=glass_gap_t, in_13=glass_reveal, in_14=glass_setback, in_15=gasket_t, in_16=gasket_w, in_17=isolator_w, in_18=pressure_plate_t, in_19=cover_cap_d, in_20=slab_t, in_21=slab_depth, in_22=slab_inset, in_23=bracket_w, in_24=bracket_l1, in_25=bracket_l2, in_26=bracket_t)  # PythonNet3
# ---------- kinetic_curtain_wall_engine.python (309 lines) ----------
import clr
clr.AddReference('ProtoGeometry')
from Autodesk.DesignScript.Geometry import *
import math

# Map inputs from IN list
num_bays = int(IN[0]) if IN[0] is not None else 3
num_floors = int(IN[1]) if IN[1] is not None else 2
bay_width = float(IN[2]) if IN[2] is not None else 1.50
floor_height = float(IN[3]) if IN[3] is not None else 3.50

mullion_w = float(IN[4]) if IN[4] is not None else 0.060
mullion_d = float(IN[5]) if IN[5] is not None else 0.150
mullion_t = float(IN[6]) if IN[6] is not None else 0.003

transom_w = float(IN[7]) if IN[7] is not None else 0.060
transom_d = float(IN[8]) if IN[8] is not None else 0.120
transom_t = float(IN[9]) if IN[9] is not None else 0.003

glass_outer_t = float(IN[10]) if IN[10] is not None else 0.006
glass_inner_t = float(IN[11]) if IN[11] is not None else 0.006
glass_gap_t = float(IN[12]) if IN[12] is not None else 0.016
glass_reveal = float(IN[13]) if IN[13] is not None else 0.015
glass_setback = float(IN[14]) if IN[14] is not None else 0.040

gasket_t = float(IN[15]) if IN[15] is not None else 0.004
gasket_w = float(IN[16]) if IN[16] is not None else 0.012
isolator_w = float(IN[17]) if IN[17] is not None else 0.012
pressure_plate_t = float(IN[18]) if IN[18] is not None else 0.006
cover_cap_d = float(IN[19]) if IN[19] is not None else 0.020

slab_t = float(IN[20]) if IN[20] is not None else 0.30
slab_depth = float(IN[21]) if IN[21] is not None else 1.50
slab_inset = float(IN[22]) if IN[22] is not None else 0.010

bracket_w = float(IN[23]) if IN[23] is not None else 0.080
bracket_l1 = float(IN[24]) if IN[24] is not None else 0.150
bracket_l2 = float(IN[25]) if IN[25] is not None else 0.120
bracket_t = float(IN[26]) if IN[26] is not None else 0.008

TOTAL_HEIGHT = num_floors * floor_height

def make_box(x_min, x_max, y_min, y_max, z_min, z_max):
    try:
        pt1 = Point.ByCoordinates(x_min, y_min, z_min)
        pt2 = Point.ByCoordinates(x_max, y_max, z_max)
        return Cuboid.ByCorners(pt1, pt2)
    except:
        return None

# Coords grid
X_grid = [i * bay_width for i in range(num_bays + 1)]

# Define transom elevations
Z_grid = []
Z_grid.append(0.0) # Bottom boundary
for f in range(1, num_floors):
    fz = f * floor_height
    Z_grid.append(fz - 0.15) # Head transom
    Z_grid.append(fz + 0.85) # Sill transom
Z_grid.append(TOTAL_HEIGHT) # Top boundary
Z_grid = sorted(list(set(Z_grid)))

m_list = []
t_list = []
go_list = []
gi_list = []
g_list = []
b_list = []
s_list = []
fs_list = []
fx_list = []

# Mullions with Noses
for x in X_grid:
    # Main chamber
    y_front = -glass_setback + gasket_t
    y_back  = y_front + mullion_d
    m_brep = make_box(x - mullion_w*0.5, x + mullion_w*0.5, y_front, y_back, 0.0, TOTAL_HEIGHT)
    if m_brep: m_list.append(m_brep)
    
    # Nose
    nose_w = 0.024
    y_nose_min = -glass_setback - glass_inner_t
    y_nose_max = -glass_setback + gasket_t
    m_nose_brep = make_box(x - nose_w*0.5, x + nose_w*0.5, y_nose_min, y_nose_max, 0.0, TOTAL_HEIGHT)
    if m_nose_brep: m_list.append(m_nose_brep)

# Transoms with Noses (placed at all Z_grid levels)
for k in range(len(Z_grid)):
    z = Z_grid[k]

    for i in range(num_bays):
        x_start = X_grid[i] + mullion_w*0.5
        x_end   = X_grid[i+1] - mullion_w*0.5
        length  = x_end - x_start
        if length <= 0: continue
        
        # Main transom profile
        y_front = -glass_setback + gasket_t
        y_back  = y_front + transom_d
        t_brep = make_box(x_start, x_end, y_front, y_back, z - transom_w*0.5, z + transom_w*0.5)
        if t_brep: t_list.append(t_brep)
        
        # Central nose
        nose_w = 0.024
        y_nose_min = -glass_setback - glass_inner_t
        y_nose_max = -glass_setback + gasket_t
        t_nose_brep = make_box(x_start, x_end, y_nose_min, y_nose_max, z - transom_w*0.5, z + transom_w*0.5)
        if t_nose_brep: t_list.append(t_nose_brep)

# Floor slabs and Fire Stop containment (intermediate slab levels only)
for f in range(1, num_floors):
    z_floor = f * floor_height
    y_mullion_back = -glass_setback + gasket_t + mullion_d
    slab_edge_y = y_mullion_back + slab_inset
    
    # Slab
    slab = make_box(0.0, num_bays * bay_width, slab_edge_y, slab_edge_y + slab_depth, z_floor - slab_t, z_floor)
    if slab: s_list.append(slab)
        
    # Fire wool
    firestop_wool = make_box(0.0, num_bays * bay_width, y_mullion_back, slab_edge_y, z_floor - slab_t, z_floor)
    if firestop_wool: fs_list.append(firestop_wool)
        
    # Galvanized sheet
    smoke_sheet = make_box(0.0, num_bays * bay_width, y_mullion_back, slab_edge_y + 0.050, z_floor, z_floor + 0.002)
    if smoke_sheet: b_list.append(smoke_sheet)

# Slab brackets (intermediate levels only)
for f in range(1, num_floors):
    z_floor = f * floor_height
    y_mullion_back = -glass_setback + gasket_t + mullion_d
    slab_edge_y = y_mullion_back + slab_inset
    for x in X_grid:
        leg1_l = make_box(x - mullion_w*0.5 - bracket_t, x - mullion_w*0.5, slab_edge_y, slab_edge_y + bracket_l1, z_floor, z_floor + bracket_t)
        leg2_l = make_box(x - mullion_w*0.5 - bracket_t, x - mullion_w*0.5, y_mullion_back - bracket_w, slab_edge_y, z_floor, z_floor + bracket_l2)
        if leg1_l: b_list.append(leg1_l)
        if leg2_l: b_list.append(leg2_l)
        leg1_r = make_box(x + mullion_w*0.5, x + mullion_w*0.5 + bracket_t, slab_edge_y, slab_edge_y + bracket_l1, z_floor, z_floor + bracket_t)
        leg2_r = make_box(x + mullion_w*0.5, x + mullion_w*0.5 + bracket_t, y_mullion_back - bracket_w, slab_edge_y, z_floor, z_floor + bracket_l2)
        if leg1_r: b_list.append(leg1_r)
        if leg2_r: b_list.append(leg2_r)

# Gaskets and pressure plates on Mullions
g_w_m = mullion_w * 0.5 - glass_reveal
for x in X_grid:
    g_l = make_box(x - glass_reveal - g_w_m, x - glass_reveal, -glass_setback, -glass_setback + gasket_t, 0.0, TOTAL_HEIGHT)
    g_r = make_box(x + glass_reveal, x + glass_reveal + g_w_m, -glass_setback, -glass_setback + gasket_t, 0.0, TOTAL_HEIGHT)
    if g_l: g_list.append(g_l)
    if g_r: g_list.append(g_r)
    
    gy_min = -glass_setback - glass_inner_t - glass_gap_t - glass_outer_t - gasket_t
    gy_max = gy_min + gasket_t
    og_l = make_box(x - glass_reveal - g_w_m, x - glass_reveal, gy_min, gy_max, 0.0, TOTAL_HEIGHT)
    og_r = make_box(x + glass_reveal, x + glass_reveal + g_w_m, gy_min, gy_max, 0.0, TOTAL_HEIGHT)
    if og_l: g_list.append(og_l)
    if og_r: g_list.append(og_r)
    
    iy_min = -glass_setback - glass_inner_t - glass_gap_t - glass_outer_t
    iy_max = -glass_setback - glass_inner_t
    ti = make_box(x - isolator_w*0.5, x + isolator_w*0.5, iy_min, iy_max, 0.0, TOTAL_HEIGHT)
    if ti: t_list.append(ti)
    
    py_min = -glass_setback - glass_inner_t - glass_gap_t - glass_outer_t - gasket_t - pressure_plate_t
    py_max = py_min + pressure_plate_t
    pp = make_box(x - mullion_w*0.5, x + mullion_w*0.5, py_min, py_max, 0.0, TOTAL_HEIGHT)
    if pp: t_list.append(pp)

    # Detailed Snap-on Cover Cap (chamfered polygon)
    try:
        pts_c = [
            Point.ByCoordinates(x - mullion_w*0.5, py_min, 0.0),
            Point.ByCoordinates(x - mullion_w*0.5, py_min - cover_cap_d + 0.006, 0.0),
            Point.ByCoordinates(x - mullion_w*0.5 + 0.006, py_min - cover_cap_d, 0.0),
            Point.ByCoordinates(x + mullion_w*0.5 - 0.006, py_min - cover_cap_d, 0.0),
            Point.ByCoordinates(x + mullion_w*0.5, py_min - cover_cap_d + 0.006, 0.0),
            Point.ByCoordinates(x + mullion_w*0.5, py_min, 0.0),
            Point.ByCoordinates(x - mullion_w*0.5, py_min, 0.0)
        ]
        cap = PolyCurve.ByPoints(pts_c).ExtrudeAsSolid(Vector.ByCoordinates(0, 0, 1), TOTAL_HEIGHT)
        if cap: t_list.append(cap)
    except:
        # Fallback to simple box representation
        cap = make_box(x - mullion_w*0.5, x + mullion_w*0.5, py_min - cover_cap_d, py_min, 0.0, TOTAL_HEIGHT)
        if cap: t_list.append(cap)

    # Screws as cylinders
    screw_spacing = 0.35; screw_rad = 0.004; screw_len = 0.090
    cur_z = 0.1
    while cur_z < TOTAL_HEIGHT:
        pt1 = Point.ByCoordinates(x, py_min, cur_z)
        pt2 = Point.ByCoordinates(x, py_min + screw_len, cur_z)
        cyl = Cylinder.ByPointsRadius(pt1, pt2, screw_rad)
        if cyl: fx_list.append(cyl)
        cur_z += screw_spacing

# Gaskets and accessories on Transoms
g_w_t = transom_w * 0.5 - glass_reveal
for k in range(len(Z_grid)):
    z = Z_grid[k]

    for i in range(num_bays):
        x_start = X_grid[i] + mullion_w*0.5
        x_end   = X_grid[i+1] - mullion_w*0.5
        length  = x_end - x_start
        if length <= 0: continue
        
        gy_min = -glass_setback - glass_inner_t - glass_gap_t - glass_outer_t - gasket_t
        gy_max = gy_min + gasket_t

        # Top Gaskets - skip if top boundary
        if k < len(Z_grid) - 1:
            g_t = make_box(x_start, x_end, -glass_setback, -glass_setback + gasket_t, z + glass_reveal, z + glass_reveal + g_w_t)
            if g_t: g_list.append(g_t)
            
            og_t = make_box(x_start, x_end, gy_min, gy_max, z + glass_reveal, z + glass_reveal + g_w_t)
            if og_t: g_list.append(og_t)

        # Bottom Gaskets - skip if bottom boundary
        if k > 0:
            g_b = make_box(x_start, x_end, -glass_setback, -glass_setback + gasket_t, z - glass_reveal - g_w_t, z - glass_reveal)
            if g_b: g_list.append(g_b)
            
            og_b = make_box(x_start, x_end, gy_min, gy_max, z - glass_reveal - g_w_t, z - glass_reveal)
            if og_b: g_list.append(og_b)
        
        iy_min = -glass_setback - glass_inner_t - glass_gap_t - glass_outer_t
        iy_max = -glass_setback - glass_inner_t
        ti = make_box(x_start, x_end, iy_min, iy_max, z - isolator_w*0.5, z + isolator_w*0.5)
        if ti: t_list.append(ti)
        
        py_min = -glass_setback - glass_inner_t - glass_gap_t - glass_outer_t - gasket_t - pressure_plate_t
        py_max = py_min + pressure_plate_t
        pp = make_box(x_start, x_end, py_min, py_max, z - transom_w*0.5, z + transom_w*0.5)
        if pp: t_list.append(pp)

        # Snap-on Transom Cover Cap (chamfered polygon in YZ plane extruded along X)
        try:
            pts_c = [
                Point.ByCoordinates(x_start, py_min, z + transom_w*0.5),
                Point.ByCoordinates(x_start, py_min - cover_cap_d + 0.006, z + transom_w*0.5),
                Point.ByCoordinates(x_start, py_min - cover_cap_d, z + transom_w*0.5 - 0.006),
                Point.ByCoordinates(x_start, py_min - cover_cap_d, z - transom_w*0.5 + 0.006),
                Point.ByCoordinates(x_start, py_min - cover_cap_d + 0.006, z - transom_w*0.5),
                Point.ByCoordinates(x_start, py_min, z - transom_w*0.5),
                Point.ByCoordinates(x_start, py_min, z + transom_w*0.5)
            ]
            cap = PolyCurve.ByPoints(pts_c).ExtrudeAsSolid(Vector.ByCoordinates(1, 0, 0), length)
            if cap: t_list.append(cap)
        except:
            # Fallback to simple box representation
            cap = make_box(x_start, x_end, py_min - cover_cap_d, py_min, z - transom_w*0.5, z + transom_w*0.5)
            if cap: t_list.append(cap)

        # Screws
        screw_spacing = 0.35; screw_rad = 0.004; screw_len = 0.090
        cur_x = x_start + 0.1
        while cur_x < x_end:
            pt1 = Point.ByCoordinates(cur_x, py_min, z)
            pt2 = Point.ByCoordinates(cur_x, py_min + screw_len, z)
            cyl = Cylinder.ByPointsRadius(pt1, pt2, screw_rad)
            if cyl: fx_list.append(cyl)
            cur_x += screw_spacing

# IGUs
for k in range(len(Z_grid) - 1):
    z_start = Z_grid[k]
    z_end   = Z_grid[k+1]
    for i in range(num_bays):
        x_start = X_grid[i]; x_end = X_grid[i+1]
        x1 = x_start + glass_reveal; x2 = x_end - glass_reveal
        z1 = z_start + glass_reveal; z2 = z_end - glass_reveal
        if x2 - x1 <= 0 or z2 - z1 <= 0: continue
        
        # Inner Glass
        y_in_min = -glass_setback - glass_inner_t
        y_in_max = -glass_setback
        glass_in = make_box(x1, x2, y_in_min, y_in_max, z1, z2)
        if glass_in: gi_list.append(glass_in)

        # Outer Glass
        y_ot_min = -glass_setback - glass_inner_t - glass_gap_t - glass_outer_t
        y_ot_max = y_ot_min + glass_outer_t
        glass_ot = make_box(x1, x2, y_ot_min, y_ot_max, z1, z2)
        if glass_ot: go_list.append(glass_ot)

        # Spacers and sealant
        sp_offset = 0.015; sp_width = 0.012
        sx1 = x1 + sp_offset; sx2 = x2 - sp_offset
        sz1 = z1 + sp_offset; sz2 = z2 - sp_offset
        sy_min_spacer = -glass_setback - glass_inner_t - glass_gap_t
        sy_max_spacer = -glass_setback - glass_inner_t
        if sx2 - sx1 > 0 and sz2 - sz1 > 0:
            sp_l = make_box(sx1, sx1 + sp_width, sy_min_spacer, sy_max_spacer, sz1, sz2)
            sp_r = make_box(sx2 - sp_width, sx2, sy_min_spacer, sy_max_spacer, sz1, sz2)
            sp_b = make_box(sx1 + sp_width, sx2 - sp_width, sy_min_spacer, sy_max_spacer, sz1, sz1 + sp_width)
            sp_t = make_box(sx1 + sp_width, sx2 - sp_width, sy_min_spacer, sy_max_spacer, sz2 - sp_width, sz2)
            for sp in (sp_l, sp_r, sp_b, sp_t):
                if sp: t_list.append(sp)

            se_l = make_box(x1, sx1, sy_min_spacer, sy_max_spacer, z1, z2)
            se_r = make_box(sx2, x2, sy_min_spacer, sy_max_spacer, z1, z2)
            se_b = make_box(sx1, sx2, sy_min_spacer, sy_max_spacer, z1, sz1)
            se_t = make_box(sx1, sx2, sy_min_spacer, sy_max_spacer, sz2, z2)
            for se in (se_l, se_r, se_b, se_t):
                if se: t_list.append(se)

OUT = [m_list, t_list, go_list, gi_list, g_list, b_list, s_list, fs_list, fx_list]
# ----------------------------------------

# group: EXTRACT GEOMETRY CHANNELS
extract_geometry_channels = CodeBlock(data=kinetic_curtain_wall_engine)
# ---------- extract_geometry_channels.designscript (9 lines) ----------
mullions = data[0];
transoms = data[1];
glass_outer = data[2];
glass_inner = data[3];
gaskets = data[4];
brackets = data[5];
slabs = data[6];
firestops = data[7];
fixings = data[8];
# ----------------------------------------

# group: MATERIAL COLOR SWATCHES
material_color_swatches = CodeBlock()
# ---------- material_color_swatches.designscript (9 lines) ----------
c_mullion = DSCore.Color.ByARGB(255, 35, 38, 46);
c_transom = DSCore.Color.ByARGB(255, 50, 55, 65);
c_glass_ot = DSCore.Color.ByARGB(120, 60, 140, 210);
c_glass_in = DSCore.Color.ByARGB(60, 170, 210, 240);
c_gaskets = DSCore.Color.ByARGB(255, 20, 20, 20);
c_brackets = DSCore.Color.ByARGB(255, 120, 120, 125);
c_slabs = DSCore.Color.ByARGB(255, 160, 155, 145);
c_firestops = DSCore.Color.ByARGB(255, 180, 160, 100);
c_fixings = DSCore.Color.ByARGB(255, 220, 220, 225);
# ----------------------------------------

# group: RENDER PIPELINE
render_mullions = Modifiers.GeometryColor.ByGeometryColor(geometry=extract_geometry_channels.mullions, color=material_color_swatches.c_mullion)
render_transoms = Modifiers.GeometryColor.ByGeometryColor(geometry=extract_geometry_channels.transoms, color=material_color_swatches.c_transom)
render_glass_outer = Modifiers.GeometryColor.ByGeometryColor(geometry=extract_geometry_channels.glass_outer, color=material_color_swatches.c_glass_ot)
render_glass_inner = Modifiers.GeometryColor.ByGeometryColor(geometry=extract_geometry_channels.glass_inner, color=material_color_swatches.c_glass_in)
render_gaskets = Modifiers.GeometryColor.ByGeometryColor(geometry=extract_geometry_channels.gaskets, color=material_color_swatches.c_gaskets)
render_brackets = Modifiers.GeometryColor.ByGeometryColor(geometry=extract_geometry_channels.brackets, color=material_color_swatches.c_brackets)
render_slabs = Modifiers.GeometryColor.ByGeometryColor(geometry=extract_geometry_channels.slabs, color=material_color_swatches.c_slabs)
render_firestops = Modifiers.GeometryColor.ByGeometryColor(geometry=extract_geometry_channels.firestops, color=material_color_swatches.c_firestops)
render_fixings = Modifiers.GeometryColor.ByGeometryColor(geometry=extract_geometry_channels.fixings, color=material_color_swatches.c_fixings)

# group: PERFORMANCE CALCULATOR (NATIVE GRAPH)
performance_calculator = CodeBlock(num_bays=num_bays, bay_width=bay_width, num_floors=num_floors, floor_height=floor_height) { area = (num_bays * bay_width) * (num_floors * floor_height); cost = area * 650.0; }
watch_total_area_m² = Watch(performance_calculator.area)
watch_estimated_cost = Watch(performance_calculator.cost)
