# Grasshopper definition facade_system.gh (Grasshopper 1.0.8)

# ---- group: A GRID & BAYS
# PARAMETRIC CURTAIN WALL FAÇADE SYSTEM
# AEC Omni-Bridge Model Engine — Refined Façade Engineering Definition
# GRID & BAYS
# STRUCTURAL PROFILES
# INSULATED GLAZING (IGU)
# GASKETS & PRESSURE PLATES
# SLAB & ANCHOR BRACKETS
# III. MATERIAL SPECIFICATION LEGEND
# II. FAÇADE PERFORMANCE CALCULATOR
# Total Area (m²)
# Est. Cost ($)
# PARAMETRIC FAÇADE SYSTEM — AEC Model Bridge
# Realistic, high-detail stick curtain wall generator (Audited Edition)
# 
# Sliders control:
#  A  Grid & Bays           Bay counts, floor lines, widths, floor heights
#  B  Structural Profiles   Mullion and transom section dimensions
#  C  Insulated Glazing     IGU double glazing outer/inner panes, spacer and air gap
#  D  Gaskets & Plates      Clamping pressure plate, cover caps, isolator breaks, gaskets
#  E  Slab & Brackets       Flanking concrete anchor brackets, slab thickness, extensions
# 
# Instructions:
# 1. Open Grasshopper and adjust any slider in the left column.
# 2. Viewport automatically updates dynamically via Custom Previews.
# 3. To bake into permanent Rhino objects, right-click the Custom Preview and click Bake.
# 4. Clean visual layout resembles senior facade engineering logic.
num_bays = Slider(3, range=1..10)
num_floors = Slider(2, range=1..5)
bay_width = Slider(1.5, range=0.8..3)
floor_height = Slider(3.5, range=2.5..5)

# ---- group: B STRUCTURAL PROFILES
mullion_w = Slider(0.06, range=0.03..0.1)
mullion_d = Slider(0.15, range=0.08..0.25)
mullion_t = Slider(0.003, range=0.002..0.008)
transom_w = Slider(0.06, range=0.03..0.1)
transom_d = Slider(0.12, range=0.06..0.2)
transom_t = Slider(0.003, range=0.002..0.008)

# ---- group: C INSULATED GLAZING (IGU)
glass_outer_t = Slider(0.006, range=0.004..0.015)
glass_inner_t = Slider(0.006, range=0.004..0.015)
glass_gap_t = Slider(0.016, range=0.008..0.024)
glass_reveal = Slider(0.01, range=0.005..0.025)
glass_setback = Slider(0.04, range=0.02..0.08)

# ---- group: D GASKETS & PRESSURE PLATES
gasket_t = Slider(0.004, range=0.002..0.01)
gasket_w = Slider(0.012, range=0.005..0.02)
isolator_w = Slider(0.012, range=0.006..0.024)
pressure_plate_t = Slider(0.006, range=0.004..0.015)
cover_cap_d = Slider(0.02, range=0.01..0.05)

# ---- group: E SLAB & ANCHOR BRACKETS
slab_t = Slider(0.3, range=0.15..0.5)
slab_depth = Slider(1.5, range=0.5..2.5)
slab_inset = Slider(0.01, range=0.005..0.05)
bracket_w = Slider(0.08, range=0.04..0.15)
bracket_l1 = Slider(0.15, range=0.08..0.3)
bracket_l2 = Slider(0.12, range=0.06..0.25)
bracket_t = Slider(0.008, range=0.004..0.016)

# ----
py3 = Python3Script(
    num_bays=num_bays,
    num_floors=num_floors,
    bay_width=bay_width,
    floor_height=floor_height,
    mullion_w=mullion_w,
    mullion_d=mullion_d,
    mullion_t=mullion_t,
    transom_w=transom_w,
    transom_d=transom_d,
    transom_t=transom_t,
    glass_outer_t=glass_outer_t,
    glass_inner_t=glass_inner_t,
    glass_gap_t=glass_gap_t,
    glass_reveal=glass_reveal,
    glass_setback=glass_setback,
    gasket_t=gasket_t,
    gasket_w=gasket_w,
    isolator_w=isolator_w,
    pressure_plate_t=pressure_plate_t,
    cover_cap_d=cover_cap_d,
    slab_t=slab_t,
    slab_depth=slab_depth,
    slab_inset=slab_inset,
    bracket_w=bracket_w,
    bracket_l1=bracket_l1,
    bracket_l2=bracket_l2,
    bracket_t=bracket_t)  # -> out, a, mullions, transoms, glass_outer, glass_inner, gaskets, brackets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
# ---------- py3: Python ----------
# =============================================================================
# DETAILED FAÇADE SYSTEM — Grasshopper Python Runtime Engine (Refined & Corrected)
# =============================================================================
import math
import Rhino
import Rhino.Geometry as rg
import scriptcontext as sc
import System
from System.Collections.Generic import List

# Redirect scriptcontext to Rhino Document (so we bake directly into the active Rhino scene if requested)
try:
    ghdoc = sc.doc
    sc.doc = Rhino.RhinoDoc.ActiveDoc
except:
    pass

doc = sc.doc
tol = doc.ModelAbsoluteTolerance
S = Rhino.RhinoMath.UnitScale(Rhino.UnitSystem.Meters, doc.ModelUnitSystem)

# Sliders utility
def _f(v, default):
    try: return float(v) if v is not None else default
    except: return default
def _i(v, default):
    try: return int(v) if v is not None else default
    except: return default

# Map inputs
NUM_BAYS         = _i(num_bays,         3)
NUM_FLOORS       = _i(num_floors,       2)
BAY_WIDTH        = _f(bay_width,        1.50)
FLOOR_HEIGHT     = _f(floor_height,     3.50)

MULLION_W        = _f(mullion_w,        0.060)
MULLION_D        = _f(mullion_d,        0.150)
MULLION_T        = _f(mullion_t,        0.003)

TRANSOM_W        = _f(transom_w,        0.060)
TRANSOM_D        = _f(transom_d,        0.120)
TRANSOM_T        = _f(transom_t,        0.003)

GLASS_OUTER_T    = _f(glass_outer_t,    0.006)
GLASS_INNER_T    = _f(glass_inner_t,    0.006)
GLASS_GAP_T      = _f(glass_gap_t,      0.016)
GLASS_REVEAL     = _f(glass_reveal,     0.015)
GLASS_SETBACK    = _f(glass_setback,    0.040)

GASKET_T         = _f(gasket_t,         0.004)
GASKET_W         = _f(gasket_w,         0.012)
ISOLATOR_W       = _f(isolator_w,       0.012)
PRESSURE_PLATE_T = _f(pressure_plate_t, 0.006)
COVER_CAP_D      = _f(cover_cap_d,      0.020)

SLAB_T           = _f(slab_t,           0.30)
SLAB_DEPTH       = _f(slab_depth,       1.50)
SLAB_INSET       = _f(slab_inset,       0.010)

BRACKET_W        = _f(bracket_w,        0.080)
BRACKET_L1       = _f(bracket_l1,       0.150)
BRACKET_L2       = _f(bracket_l2,       0.120)
BRACKET_T        = _f(bracket_t,        0.008)

# Scale to active units
BAY_WIDTH        *= S; FLOOR_HEIGHT     *= S
MULLION_W        *= S; MULLION_D        *= S; MULLION_T        *= S
TRANSOM_W        *= S; TRANSOM_D        *= S; TRANSOM_T        *= S
GLASS_OUTER_T    *= S; GLASS_INNER_T    *= S; GLASS_GAP_T      *= S
GLASS_REVEAL     *= S; GLASS_SETBACK    *= S
GASKET_T         *= S; GASKET_W         *= S; ISOLATOR_W       *= S
PRESSURE_PLATE_T *= S; COVER_CAP_D      *= S
SLAB_T           *= S; SLAB_DEPTH       *= S; SLAB_INSET       *= S
BRACKET_W        *= S; BRACKET_L1       *= S; BRACKET_L2       *= S; BRACKET_T *= S

TOTAL_HEIGHT = NUM_FLOORS * FLOOR_HEIGHT

def make_hollow_tube(plane, w, y_min, y_max, length):
    rect = rg.Rectangle3d(rg.Plane.WorldXY, rg.Interval(-w*0.5, w*0.5), rg.Interval(y_min, y_max))
    ext = rg.Extrusion.Create(rect.ToNurbsCurve(), length, True).ToBrep()
    if ext:
        xf = rg.Transform.PlaneToPlane(rg.Plane.WorldXY, plane)
        ext.Transform(xf)
        return ext
    return None

# Coords grid
X_grid = [i * BAY_WIDTH for i in range(NUM_BAYS + 1)]

# Define transom elevations
Z_grid = []
Z_grid.append(0.0) # Bottom boundary (Sill)
for f in range(1, NUM_FLOORS):
    fz = f * FLOOR_HEIGHT
    Z_grid.append(fz - 0.15 * S) # Head transom: 150mm below slab level
    Z_grid.append(fz + 0.85 * S) # Sill transom: 850mm above slab level
Z_grid.append(TOTAL_HEIGHT) # Top boundary (Head)
Z_grid = sorted(list(set(Z_grid)))

m_list = List[rg.Brep]()
t_list = List[rg.Brep]()
go_list = List[rg.Brep]()
gi_list = List[rg.Brep]()
g_list = List[rg.Brep]()
b_list = List[rg.Brep]()
fs_list = List[rg.Brep]()
fx_list = List[rg.Brep]()
s_list = List[rg.Brep]()
n_glass = 0

# Mullions with Noses
for x in X_grid:
    m_plane = rg.Plane(rg.Point3d(x, 0.0, 0.0), rg.Vector3d.XAxis, rg.Vector3d.YAxis)
    y_front = -GLASS_SETBACK + GASKET_T
    y_back  = y_front + MULLION_D
    m_brep = make_hollow_tube(m_plane, MULLION_W, y_front, y_back, TOTAL_HEIGHT)
    if m_brep: m_list.Add(m_brep)
    
    nose_w = 0.024 * S
    y_nose_min = -GLASS_SETBACK - GLASS_INNER_T
    y_nose_max = -GLASS_SETBACK + GASKET_T
    m_nose_brep = make_hollow_tube(m_plane, nose_w, y_nose_min, y_nose_max, TOTAL_HEIGHT)
    if m_nose_brep: m_list.Add(m_nose_brep)

# Transoms with Noses (placed at all Z_grid levels)
for k in range(len(Z_grid)):
    z = Z_grid[k]

    for i in range(NUM_BAYS):
        x_start = X_grid[i] + MULLION_W*0.5
        x_end   = X_grid[i+1] - MULLION_W*0.5
        length  = x_end - x_start
        if length <= 0: continue
        
        t_plane = rg.Plane(rg.Point3d(x_start, 0.0, z), -rg.Vector3d.ZAxis, rg.Vector3d.YAxis)
        y_front = -GLASS_SETBACK + GASKET_T
        y_back  = y_front + TRANSOM_D
        t_brep = make_hollow_tube(t_plane, TRANSOM_W, y_front, y_back, length)
        if t_brep: t_list.Add(t_brep)
        
        nose_w = 0.024 * S
        y_nose_min = -GLASS_SETBACK - GLASS_INNER_T
        y_nose_max = -GLASS_SETBACK + GASKET_T
        t_nose_brep = make_hollow_tube(t_plane, nose_w, y_nose_min, y_nose_max, length)
        if t_nose_brep: t_list.Add(t_nose_brep)

# Floor slabs and Fire Stop containment (intermediate levels only)
for f in range(1, NUM_FLOORS):
    z_floor = f * FLOOR_HEIGHT
    y_mullion_back = -GLASS_SETBACK + GASKET_T + MULLION_D
    slab_edge_y = y_mullion_back + SLAB_INSET
    
    # Slab
    slab = rg.Box(rg.Plane.WorldXY, rg.Interval(0.0, NUM_BAYS * BAY_WIDTH), rg.Interval(slab_edge_y, slab_edge_y + SLAB_DEPTH), rg.Interval(z_floor - SLAB_T, z_floor)).ToBrep()
    if slab: s_list.Add(slab)
        
    # Fire wool
    firestop_wool = rg.Box(rg.Plane.WorldXY, rg.Interval(0.0, NUM_BAYS * BAY_WIDTH), rg.Interval(y_mullion_back, slab_edge_y), rg.Interval(z_floor - SLAB_T, z_floor)).ToBrep()
    if firestop_wool: fs_list.Add(firestop_wool)
        
    # Galvanized sheet
    smoke_sheet = rg.Box(rg.Plane.WorldXY, rg.Interval(0.0, NUM_BAYS * BAY_WIDTH), rg.Interval(y_mullion_back, slab_edge_y + 0.050*S), rg.Interval(z_floor, z_floor + 0.002*S)).ToBrep()
    if smoke_sheet: b_list.Add(smoke_sheet)

# Slab brackets (intermediate levels only)
for f in range(1, NUM_FLOORS):
    z_floor = f * FLOOR_HEIGHT
    y_mullion_back = -GLASS_SETBACK + GASKET_T + MULLION_D
    slab_edge_y = y_mullion_back + SLAB_INSET
    for x in X_grid:
        leg1_l = rg.Box(rg.Plane.WorldXY, rg.Interval(x - MULLION_W*0.5 - BRACKET_T, x - MULLION_W*0.5), rg.Interval(slab_edge_y, slab_edge_y + BRACKET_L1), rg.Interval(z_floor, z_floor + BRACKET_T)).ToBrep()
        leg2_l = rg.Box(rg.Plane.WorldXY, rg.Interval(x - MULLION_W*0.5 - BRACKET_T, x - MULLION_W*0.5), rg.Interval(y_mullion_back - BRACKET_W, slab_edge_y), rg.Interval(z_floor, z_floor + BRACKET_L2)).ToBrep()
        if leg1_l: b_list.Add(leg1_l)
        if leg2_l: b_list.Add(leg2_l)
        leg1_r = rg.Box(rg.Plane.WorldXY, rg.Interval(x + MULLION_W*0.5, x + MULLION_W*0.5 + BRACKET_T), rg.Interval(slab_edge_y, slab_edge_y + BRACKET_L1), rg.Interval(z_floor, z_floor + BRACKET_T)).ToBrep()
        leg2_r = rg.Box(rg.Plane.WorldXY, rg.Interval(x + MULLION_W*0.5, x + MULLION_W*0.5 + BRACKET_T), rg.Interval(y_mullion_back - BRACKET_W, slab_edge_y), rg.Interval(z_floor, z_floor + BRACKET_L2)).ToBrep()
        if leg1_r: b_list.Add(leg1_r)
        if leg2_r: b_list.Add(leg2_r)

# Gaskets and pressure plates on Mullions
g_w_m = MULLION_W * 0.5 - GLASS_REVEAL  # Dynamic gasket width matching mullion shoulders

for x in X_grid:
    g_l = rg.Box(rg.Plane.WorldXY, rg.Interval(x - GLASS_REVEAL - g_w_m, x - GLASS_REVEAL), rg.Interval(-GLASS_SETBACK, -GLASS_SETBACK + GASKET_T), rg.Interval(0.0, TOTAL_HEIGHT)).ToBrep()
    g_r = rg.Box(rg.Plane.WorldXY, rg.Interval(x + GLASS_REVEAL, x + GLASS_REVEAL + g_w_m), rg.Interval(-GLASS_SETBACK, -GLASS_SETBACK + GASKET_T), rg.Interval(0.0, TOTAL_HEIGHT)).ToBrep()
    if g_l: g_list.Add(g_l)
    if g_r: g_list.Add(g_r)
    
    gy_min = -GLASS_SETBACK - GLASS_INNER_T - GLASS_GAP_T - GLASS_OUTER_T - GASKET_T
    gy_max = gy_min + GASKET_T
    og_l = rg.Box(rg.Plane.WorldXY, rg.Interval(x - GLASS_REVEAL - g_w_m, x - GLASS_REVEAL), rg.Interval(gy_min, gy_max), rg.Interval(0.0, TOTAL_HEIGHT)).ToBrep()
    og_r = rg.Box(rg.Plane.WorldXY, rg.Interval(x + GLASS_REVEAL, x + GLASS_REVEAL + g_w_m), rg.Interval(gy_min, gy_max), rg.Interval(0.0, TOTAL_HEIGHT)).ToBrep()
    if og_l: g_list.Add(og_l)
    if og_r: g_list.Add(og_r)

    
    iy_min = -GLASS_SETBACK - GLASS_INNER_T - GLASS_GAP_T - GLASS_OUTER_T
    iy_max = -GLASS_SETBACK - GLASS_INNER_T
    ti = rg.Box(rg.Plane.WorldXY, rg.Interval(x - ISOLATOR_W*0.5, x + ISOLATOR_W*0.5), rg.Interval(iy_min, iy_max), rg.Interval(0.0, TOTAL_HEIGHT)).ToBrep()
    if ti: t_list.Add(ti)
    
    py_min = -GLASS_SETBACK - GLASS_INNER_T - GLASS_GAP_T - GLASS_OUTER_T - GASKET_T - PRESSURE_PLATE_T
    py_max = py_min + PRESSURE_PLATE_T
    pp = rg.Box(rg.Plane.WorldXY, rg.Interval(x - MULLION_W*0.5, x + MULLION_W*0.5), rg.Interval(py_min, py_max), rg.Interval(0.0, TOTAL_HEIGHT)).ToBrep()
    if pp: t_list.Add(pp)

    # Caps
    pts_c = [
        rg.Point3d(-MULLION_W*0.5, 0.0, 0.0),
        rg.Point3d(-MULLION_W*0.5, -COVER_CAP_D + 0.006*S, 0.0),
        rg.Point3d(-MULLION_W*0.5 + 0.006*S, -COVER_CAP_D, 0.0),
        rg.Point3d(MULLION_W*0.5 - 0.006*S, -COVER_CAP_D, 0.0),
        rg.Point3d(MULLION_W*0.5, -COVER_CAP_D + 0.006*S, 0.0),
        rg.Point3d(MULLION_W*0.5, 0.0, 0.0),
        rg.Point3d(-MULLION_W*0.5, 0.0, 0.0)
    ]
    pl = rg.Polyline(pts_c).ToNurbsCurve()
    ext = rg.Extrusion.Create(pl, TOTAL_HEIGHT, True).ToBrep()
    if ext:
        ext.Transform(rg.Transform.PlaneToPlane(rg.Plane.WorldXY, rg.Plane(rg.Point3d(x, py_min, 0.0), rg.Vector3d.XAxis, rg.Vector3d.YAxis)))
        t_list.Add(ext)

    # Screws
    screw_spacing = 0.35 * S; screw_rad = 0.004 * S; screw_len = 0.090 * S
    cur_z = 0.1 * S
    while cur_z < TOTAL_HEIGHT:
        cyl_plane = rg.Plane(rg.Point3d(x, py_min, cur_z), rg.Vector3d.YAxis)
        cyl = rg.Cylinder(rg.Circle(cyl_plane, screw_rad), screw_len).ToBrep(True, True)
        if cyl: fx_list.Add(cyl)
        cur_z += screw_spacing

# Gaskets and accessories on Transoms
g_w_t = TRANSOM_W * 0.5 - GLASS_REVEAL  # Dynamic gasket width matching transom shoulders

for k in range(len(Z_grid)):
    z = Z_grid[k]

    for i in range(NUM_BAYS):
        x_start = X_grid[i] + MULLION_W*0.5
        x_end   = X_grid[i+1] - MULLION_W*0.5
        length  = x_end - x_start
        if length <= 0: continue
        
        gy_min = -GLASS_SETBACK - GLASS_INNER_T - GLASS_GAP_T - GLASS_OUTER_T - GASKET_T
        gy_max = gy_min + GASKET_T

        # Top Gaskets (seal the glass above the transom) - skip if top boundary
        if k < len(Z_grid) - 1:
            g_t = rg.Box(rg.Plane.WorldXY, rg.Interval(x_start, x_end), rg.Interval(-GLASS_SETBACK, -GLASS_SETBACK + GASKET_T), rg.Interval(z + GLASS_REVEAL, z + GLASS_REVEAL + g_w_t)).ToBrep()
            if g_t: g_list.Add(g_t)
            
            og_t = rg.Box(rg.Plane.WorldXY, rg.Interval(x_start, x_end), rg.Interval(gy_min, gy_max), rg.Interval(z + GLASS_REVEAL, z + GLASS_REVEAL + g_w_t)).ToBrep()
            if og_t: g_list.Add(og_t)

        # Bottom Gaskets (seal the glass below the transom) - skip if bottom boundary
        if k > 0:
            g_b = rg.Box(rg.Plane.WorldXY, rg.Interval(x_start, x_end), rg.Interval(-GLASS_SETBACK, -GLASS_SETBACK + GASKET_T), rg.Interval(z - GLASS_REVEAL - g_w_t, z - GLASS_REVEAL)).ToBrep()
            if g_b: g_list.Add(g_b)
            
            og_b = rg.Box(rg.Plane.WorldXY, rg.Interval(x_start, x_end), rg.Interval(gy_min, gy_max), rg.Interval(z - GLASS_REVEAL - g_w_t, z - GLASS_REVEAL)).ToBrep()
            if og_b: g_list.Add(og_b)

        
        iy_min = -GLASS_SETBACK - GLASS_INNER_T - GLASS_GAP_T - GLASS_OUTER_T
        iy_max = -GLASS_SETBACK - GLASS_INNER_T
        ti = rg.Box(rg.Plane.WorldXY, rg.Interval(x_start, x_end), rg.Interval(iy_min, iy_max), rg.Interval(z - ISOLATOR_W*0.5, z + ISOLATOR_W*0.5)).ToBrep()
        if ti: t_list.Add(ti)
        
        py_min = -GLASS_SETBACK - GLASS_INNER_T - GLASS_GAP_T - GLASS_OUTER_T - GASKET_T - PRESSURE_PLATE_T
        py_max = py_min + PRESSURE_PLATE_T
        pp = rg.Box(rg.Plane.WorldXY, rg.Interval(x_start, x_end), rg.Interval(py_min, py_max), rg.Interval(z - TRANSOM_W*0.5, z + TRANSOM_W*0.5)).ToBrep()
        if pp: t_list.Add(pp)

        # Transom cap
        pts_c = [
            rg.Point3d(-TRANSOM_W*0.5, 0.0, 0.0),
            rg.Point3d(-TRANSOM_W*0.5, -COVER_CAP_D + 0.006*S, 0.0),
            rg.Point3d(-TRANSOM_W*0.5 + 0.006*S, -COVER_CAP_D, 0.0),
            rg.Point3d(TRANSOM_W*0.5 - 0.006*S, -COVER_CAP_D, 0.0),
            rg.Point3d(TRANSOM_W*0.5, -COVER_CAP_D + 0.006*S, 0.0),
            rg.Point3d(TRANSOM_W*0.5, 0.0, 0.0),
            rg.Point3d(-TRANSOM_W*0.5, 0.0, 0.0)
        ]
        pl = rg.Polyline(pts_c).ToNurbsCurve()
        ext = rg.Extrusion.Create(pl, length, True).ToBrep()
        if ext:
            ext.Transform(rg.Transform.PlaneToPlane(rg.Plane.WorldXY, rg.Plane(rg.Point3d(x_start, py_min, z), -rg.Vector3d.ZAxis, rg.Vector3d.YAxis)))
            t_list.Add(ext)

        # Screws
        screw_spacing = 0.35 * S; screw_rad = 0.004 * S; screw_len = 0.090 * S
        cur_x = x_start + 0.1 * S
        while cur_x < x_end:
            cyl_plane = rg.Plane(rg.Point3d(cur_x, py_min, z), rg.Vector3d.YAxis)
            cyl = rg.Cylinder(rg.Circle(cyl_plane, screw_rad), screw_len).ToBrep(True, True)
            if cyl: fx_list.Add(cyl)
            cur_x += screw_spacing

# IGUs
for k in range(len(Z_grid) - 1):
    z_start = Z_grid[k]
    z_end   = Z_grid[k+1]
    for i in range(NUM_BAYS):
        x_start = X_grid[i]; x_end = X_grid[i+1]
        x1 = x_start + GLASS_REVEAL; x2 = x_end - GLASS_REVEAL
        z1 = z_start + GLASS_REVEAL; z2 = z_end - GLASS_REVEAL
        if x2 - x1 <= 0 or z2 - z1 <= 0: continue
        
        # Inner Glass
        y_in_min = -GLASS_SETBACK - GLASS_INNER_T
        y_in_max = -GLASS_SETBACK
        glass_in = rg.Box(rg.Plane.WorldXY, rg.Interval(x1, x2), rg.Interval(y_in_min, y_in_max), rg.Interval(z1, z2)).ToBrep()
        if glass_in: gi_list.Add(glass_in)

        # Outer Glass
        y_ot_min = -GLASS_SETBACK - GLASS_INNER_T - GLASS_GAP_T - GLASS_OUTER_T
        y_ot_max = y_ot_min + GLASS_OUTER_T
        glass_ot = rg.Box(rg.Plane.WorldXY, rg.Interval(x1, x2), rg.Interval(y_ot_min, y_ot_max), rg.Interval(z1, z2)).ToBrep()
        if glass_ot: go_list.Add(glass_ot)

        # Spacers and sealant
        sp_offset = 0.015 * S; sp_width = 0.012 * S
        sx1 = x1 + sp_offset; sx2 = x2 - sp_offset
        sz1 = z1 + sp_offset; sz2 = z2 - sp_offset
        sy_min_spacer = -GLASS_SETBACK - GLASS_INNER_T - GLASS_GAP_T
        sy_max_spacer = -GLASS_SETBACK - GLASS_INNER_T
        if sx2 - sx1 > 0 and sz2 - sz1 > 0:
            sp_l = rg.Box(rg.Plane.WorldXY, rg.Interval(sx1, sx1 + sp_width), rg.Interval(sy_min_spacer, sy_max_spacer), rg.Interval(sz1, sz2)).ToBrep()
            sp_r = rg.Box(rg.Plane.WorldXY, rg.Interval(sx2 - sp_width, sx2), rg.Interval(sy_min_spacer, sy_max_spacer), rg.Interval(sz1, sz2)).ToBrep()
            sp_b = rg.Box(rg.Plane.WorldXY, rg.Interval(sx1 + sp_width, sx2 - sp_width), rg.Interval(sy_min_spacer, sy_max_spacer), rg.Interval(sz1, sz1 + sp_width)).ToBrep()
            sp_t = rg.Box(rg.Plane.WorldXY, rg.Interval(sx1 + sp_width, sx2 - sp_width), rg.Interval(sy_min_spacer, sy_max_spacer), rg.Interval(sz2 - sp_width, sz2)).ToBrep()
            for sp in (sp_l, sp_r, sp_b, sp_t):
                if sp: t_list.Add(sp)

            se_l = rg.Box(rg.Plane.WorldXY, rg.Interval(x1, sx1), rg.Interval(sy_min_spacer, sy_max_spacer), rg.Interval(z1, z2)).ToBrep()
            se_r = rg.Box(rg.Plane.WorldXY, rg.Interval(sx2, x2), rg.Interval(sy_min_spacer, sy_max_spacer), rg.Interval(z1, z2)).ToBrep()
            se_b = rg.Box(rg.Plane.WorldXY, rg.Interval(sx1, sx2), rg.Interval(sy_min_spacer, sy_max_spacer), rg.Interval(z1, sz1)).ToBrep()
            se_t = rg.Box(rg.Plane.WorldXY, rg.Interval(sx1, sx2), rg.Interval(sy_min_spacer, sy_max_spacer), rg.Interval(sz2, z2)).ToBrep()
            for se in (se_l, se_r, se_b, se_t):
                if se: t_list.Add(se)
        n_glass += 1

mullions = m_list
transoms = t_list
glass_outer = go_list
glass_inner = gi_list
gaskets = g_list
brackets = b_list
firestops = fs_list
fixings = fx_list
slabs = s_list
# Restore Grasshopper scriptcontext
try:
    sc.doc = ghdoc
except:
    pass
# ---------- end py3 ----------

# ---- group: MATERIAL LEGEND & SPECIFICATIONS
# Mullion Profiles
# Alu 6063-T6, Anodized
# Sightline 60mm, D=150mm
# Uf = 1.6 W/m²K
# Transom Profiles & Accessories
# Transom 60x120mm, Cover Caps,
# Pressure Plates, Thermal Isolator
# Outer Glass Pane
# 6mm solar-control, tinted
# Solar heat gain g = 0.38
# Ug = 1.1 W/m²K
# Inner Glass Pane
# 6mm clear float
# Room-side glazing surface
# EPDM Weather Gaskets
# Continuous internal & external
# perimeter air/water barrier seals
# Anchor Brackets & Sheets
# Galvanized steel flanking legs &
# 2mm sheet smoke containment
# Concrete Floor Slabs
# C30/37 reinforced structural slab
# Thickness = 300mm
# Perimeter Fire Safing
# 2-hour rated rockwool fire stop
# between slab edge & mullion back
# Structural Screws & Bolts
# M8 stainless steel screws
# spaced at 350mm centers
swatch = ColourSwatch(SwatchColor=RGBA(38, 46, 255, 35))
preview = CustomPreview(Geometry=py3.mullions, Material=swatch)
preview_2 = CustomPreview(Geometry=py3.transoms, Material=ColourSwatch(SwatchColor=RGBA(55, 65, 255, 50)))
preview_3 = CustomPreview(Geometry=py3.glass_outer, Material=ColourSwatch(SwatchColor=RGBA(140, 210, 100, 60)))
preview_4 = CustomPreview(Geometry=py3.glass_inner, Material=ColourSwatch(SwatchColor=RGBA(210, 240, 60, 170)))
preview_5 = CustomPreview(Geometry=py3.gaskets, Material=ColourSwatch(SwatchColor=RGBA(20, 20, 255, 20)))
preview_6 = CustomPreview(Geometry=py3.brackets, Material=ColourSwatch(SwatchColor=RGBA(120, 125, 255, 120)))
preview_7 = CustomPreview(Geometry=py3.slabs, Material=ColourSwatch(SwatchColor=RGBA(155, 145, 255, 160)))
preview_8 = CustomPreview(Geometry=py3.firestops, Material=ColourSwatch(SwatchColor=RGBA(160, 100, 255, 180)))
preview_9 = CustomPreview(Geometry=py3.fixings, Material=ColourSwatch(SwatchColor=RGBA(220, 225, 255, 220)))

# ---- group: PERFORMANCE CALCULATOR (NATIVE GRAPH)
multiplication = Multiplication(A=num_bays, B=bay_width)
multiplication_2 = Multiplication(A=num_floors, B=floor_height)
multiplication_3 = Multiplication(A=multiplication, B=multiplication_2)
multiplication_4 = Multiplication(A=multiplication_3, B=650)
panel = Panel(multiplication_3)
panel_2 = Panel(multiplication_4)
